# Grasshopper definition mobius.gh (Grasshopper 0.9.76)
# plug-ins: Biomorpher, LunchBox, Weaverbird

number_slider = Slider(99, range=30..100)
number_slider_2 = Slider(0.78, range=0..1)
number_slider_3 = Slider(10, range=2..10)
mobius = MobiusSurface(
    UDivisions=100,
    VDivisions=100,
    RParameter=4,
    TParameter=0.5,
    Scale=5,
    Domain1=Domain(-3.141592654, 3.141592654),
    Domain2=Domain(-1, 1))
hex = HexagonCells(Surface=mobius, UDivisions=number_slider, VDivisions=number_slider_3, TParameter=number_slider_2)  # -> HexagonCells, Centers
wbframe = WeaverbirdsPictureFrame(MeshPolylines=hex.HexagonCells, Distance=5, InsetType=0)
wbthicken = WeaverbirdsMeshThicken(MeshCurves=wbframe, Distance=5, OffsetType=0)
biomorpher = Biomorpher(Genome=[number_slider_3, number_slider, number_slider_2], Geometry=wbthicken)
